# Grasshopper definition NeighborhoodGenerator.gh (Grasshopper 1.0.8)

# ----
# Disclaimer: Scripted by María Sánchez Domínguez
# INPUTS
# OUTPUTS
# EXPORT
# OPERATIONS
panel = Panel("http://james-ramsden.com/change-the-colour-of-the-grasshopper-canvas/")
c_script = CSharpScript(
    switcher=Toggle(True),
    canvasBack=ColourSwatch(SwatchColor=RGB(54, 54, 54)),
    canvasGrid=ColourSwatch(SwatchColor=RGB(105, 105, 105)),
    canvasEdge=ColourSwatch(SwatchColor=RGB(255, 255, 255)),
    canvasShade=ColourSwatch(SwatchColor=RGBA(255, 0, 166, 88)))  # -> out; inputs switcher: Boolean, canvasBack: Color, canvasGrid: Color, canvasEdge: Color, canvasShade: Color
# ---------- c_script: C# ----------
// Grasshopper Script Instance

using System;
using System.Collections;
using System.Collections.Generic;

using Rhino;
using Rhino.Geometry;

using Grasshopper;
using Grasshopper.Kernel;
using Grasshopper.Kernel.Data;
using Grasshopper.Kernel.Types;

using System.Drawing;

/// <summary>
/// This class will be instantiated on demand by the Script component.
/// </summary>
public class Script_Instance : GH_ScriptInstance
{
  /// <summary>Print a String to the [Out] Parameter of the Script component.</summary>
  /// <param name="text">String to print.</param>
  private void Print(string text) { /* Implementation hidden. */ }
  /// <summary>Print a formatted String to the [Out] Parameter of the Script component.</summary>
  /// <param name="format">String format.</param>
  /// <param name="args">Formatting parameters.</param>
  private void Print(string format, params object[] args) { /* Implementation hidden. */ }
  /// <summary>Print useful information about an object instance to the [Out] Parameter of the Script component. </summary>
  /// <param name="obj">Object instance to parse.</param>
  private void Reflect(object obj) { /* Implementation hidden. */ }
  /// <summary>Print the signatures of all the overloads of a specific method to the [Out] Parameter of the Script component. </summary>
  /// <param name="obj">Object instance to parse.</param>
  private void Reflect(object obj, string method_name) { /* Implementation hidden. */ }

  /// <summary>Gets the current Rhino document.</summary>
  private readonly RhinoDoc RhinoDocument;
  /// <summary>Gets the Grasshopper document that owns this script.</summary>
  private readonly GH_Document GrasshopperDocument;
  /// <summary>Gets the Grasshopper script component that owns this script.</summary>
  private readonly IGH_Component Component;
  /// <summary>
  /// Gets the current iteration count. The first call to RunScript() is associated with Iteration==0.
  /// Any subsequent call within the same solution will increment the Iteration count.
  /// </summary>
  private readonly int Iteration;

  /// <summary>
  /// This procedure contains the user code. Input parameters are provided as regular arguments,
  /// Output parameters as ref arguments. You don't have to assign output parameters,
  /// they will have a default value.
  /// </summary>
  private void RunScript(
		bool switcher,
		Color canvasBack,
		Color canvasGrid,
		Color canvasEdge,
		Color canvasShade)
  {

    if (switcher == true)
    {
      Grasshopper.GUI.Canvas.GH_Skin.canvas_back = canvasBack;
      Grasshopper.GUI.Canvas.GH_Skin.canvas_grid = canvasGrid;
      Grasshopper.GUI.Canvas.GH_Skin.canvas_edge = canvasEdge;
      Grasshopper.GUI.Canvas.GH_Skin.canvas_shade = canvasShade;
    }
    else
    {
      Grasshopper.GUI.Canvas.GH_Skin.canvas_back = Color.FromArgb(212, 208, 200);
      Grasshopper.GUI.Canvas.GH_Skin.canvas_grid = Color.FromArgb(30, 0, 0, 0);
      Grasshopper.GUI.Canvas.GH_Skin.canvas_edge = Color.FromArgb(0, 0, 0);
      Grasshopper.GUI.Canvas.GH_Skin.canvas_shade = Color.FromArgb(80, 0, 0, 0);
    }

  }

  // <Custom additional code> 


  /// <summary>
  /// This method will be called once every solution, before any calls to RunScript.
  /// </summary>
  public override void BeforeRunScript()
  { }
  /// <summary>
  /// This method will be called once every solution, after any calls to RunScript.
  /// </summary>
  public override void AfterRunScript()
  { }

  // </Custom additional code> 
}
# ---------- end c_script ----------

number_slider = Slider(3, range=3..10)
python_3_script = Python3Script(
    area_size=Slider(256, range=200..600),
    n_districts=Slider(2, range=1..4),
    block_size=Slider(39, range=30..80),
    bldg_setback=number_slider,
    lamp_spacing=Slider(20, range=20..75),
    rand_seed=Slider(8, range=0..25),
    export_folder="G:\My Drive\AIA - Data Encoding\GHNeighborhoods",
    run_export=Toggle(False))  # -> out, streets, bldg_volumes, lamps, lamp_sticks
# ---------- python_3_script: Python ----------
import Rhino.Geometry as rg
from Rhino.Geometry.Intersect import Intersection
import random, math, os, csv

# ── Helpers ────────────────────────────────────────────────────────────────────

def make_rect_crv(ox, oy, w, h):
    pts = [rg.Point3d(ox,oy,0), rg.Point3d(ox+w,oy,0),
           rg.Point3d(ox+w,oy+h,0), rg.Point3d(ox,oy+h,0), rg.Point3d(ox,oy,0)]
    return rg.PolylineCurve(pts)

def clip_to_boundary(line_crv, boundary_crv):
    events = Intersection.CurveCurve(line_crv, boundary_crv, 0.01, 0.01)
    if not events or events.Count < 2:
        return []
    params = sorted([events[i].ParameterA for i in range(events.Count)])
    result = line_crv.Trim(params[0], params[-1])
    return [result] if result else []

def crv_to_wkt(crv):
    pts = [crv.PointAt(crv.Domain.ParameterAt(t/10.0)) for t in range(11)]
    return 'LINESTRING (' + ', '.join(f'{p.X:.3f} {p.Y:.3f}' for p in pts) + ')'

def poly_to_wkt(pts):
    coords = ', '.join(f'{p.X:.3f} {p.Y:.3f}' for p in pts)
    return f'POLYGON (({coords}))'

def pt_to_wkt(pt):
    return f'POINT ({pt.X:.3f} {pt.Y:.3f})'

# ── Setup ──────────────────────────────────────────────────────────────────────
rnd = random.Random(rand_seed)
streets_out   = []
buildings_out = []  # (surface, height_m, corner_pts)
lamps_out     = []
msgs          = []

# ── 1. Districts with different orientations ────────────────────────────────────
dist_cols = max(1, int(math.ceil(math.sqrt(n_districts))))
dist_rows = max(1, int(math.ceil(n_districts / float(dist_cols))))
dist_w = area_size / dist_cols
dist_h = area_size / dist_rows

for dr in range(dist_rows):
    for dc in range(dist_cols):
        if dr * dist_cols + dc >= n_districts:
            break

        ox, oy   = dc * dist_w, dr * dist_h
        cx, cy   = ox + dist_w / 2, oy + dist_h / 2
        angle    = rnd.uniform(-math.pi/4, math.pi/4)  # -45° to +45°
        cos_a, sin_a = math.cos(angle), math.sin(angle)
        boundary = make_rect_crv(ox, oy, dist_w, dist_h)
        half_diag = math.sqrt(dist_w**2 + dist_h**2)

        n_steps = int(half_diag / block_size) + 2
        for i in range(-n_steps, n_steps + 1):
            off = i * block_size

            # Horizontal streets (rotated)
            p1 = rg.Point3d(cx + cos_a*(-half_diag) - sin_a*off,
                            cy + sin_a*(-half_diag) + cos_a*off, 0)
            p2 = rg.Point3d(cx + cos_a*(half_diag)  - sin_a*off,
                            cy + sin_a*(half_diag)  + cos_a*off, 0)
            streets_out.extend(clip_to_boundary(rg.LineCurve(p1, p2), boundary))

            # Vertical streets (rotated)
            p1 = rg.Point3d(cx + cos_a*off - sin_a*(-half_diag),
                            cy + sin_a*off + cos_a*(-half_diag), 0)
            p2 = rg.Point3d(cx + cos_a*off - sin_a*(half_diag),
                            cy + sin_a*off + cos_a*(half_diag), 0)
            streets_out.extend(clip_to_boundary(rg.LineCurve(p1, p2), boundary))

msgs.append(f'Streets: {len(streets_out)}')

# ── 2. Buildings along each street ─────────────────────────────────────────────
for seg in streets_out:
    seg_len = seg.GetLength()
    if seg_len < block_size * 0.3:
        continue

    sp = seg.PointAtStart
    ep = seg.PointAtEnd
    dx, dy = ep.X - sp.X, ep.Y - sp.Y
    ln = math.sqrt(dx**2 + dy**2)
    if ln < 1: continue
    ux, uy = dx/ln, dy/ln          # along street
    nx, ny = -uy, ux               # normal (left side)

    for side in [1, -1]:
        pos = bldg_setback
        while pos < seg_len - 5:
            bw = rnd.uniform(8, 20)    # width along street
            bd = rnd.uniform(8, 18)    # depth perpendicular
            bh = rnd.uniform(6, 30)    # height in metres
            if pos + bw > seg_len - 5:
                break
            sd = bldg_setback
            p0 = rg.Point3d(sp.X + ux*pos        + side*nx*sd,       sp.Y + uy*pos        + side*ny*sd, 0)
            p1 = rg.Point3d(sp.X + ux*(pos+bw)   + side*nx*sd,       sp.Y + uy*(pos+bw)   + side*ny*sd, 0)
            p2 = rg.Point3d(sp.X + ux*(pos+bw)   + side*nx*(sd+bd),  sp.Y + uy*(pos+bw)   + side*ny*(sd+bd), 0)
            p3 = rg.Point3d(sp.X + ux*pos        + side*nx*(sd+bd),  sp.Y + uy*pos        + side*ny*(sd+bd), 0)
            srf = rg.NurbsSurface.CreateFromCorners(p0, p1, p2, p3)
            if srf:
                buildings_out.append((srf, round(bh, 1), [p0, p1, p2, p3, p0]))
            pos += bw + rnd.uniform(1, 4)

msgs.append(f'Buildings: {len(buildings_out)}')

# ── 3. Lamp posts along streets ────────────────────────────────────────────────
for seg in streets_out:
    seg_len = seg.GetLength()
    if seg_len < 5: continue
    sp, ep = seg.PointAtStart, seg.PointAtEnd
    dx, dy = ep.X - sp.X, ep.Y - sp.Y
    ln = math.sqrt(dx**2 + dy**2)
    if ln < 1: continue
    nx, ny = -dy/ln, dx/ln

    pos = rnd.uniform(0, lamp_spacing)
    while pos < seg_len:
        ok, t = seg.LengthParameter(pos)
        if ok:
            pt = seg.PointAt(t)
            side_off = rnd.choice([1, -1]) * rnd.uniform(2, 4)
            lamps_out.append(rg.Point3d(pt.X + nx*side_off, pt.Y + ny*side_off, 0))
        pos += lamp_spacing * rnd.uniform(0.75, 1.25)

msgs.append(f'Lamps: {len(lamps_out)}')

# ── 4. Outputs ────────────────────────────────────────────────────────────────
streets   = streets_out
lamps     = lamps_out

# Flat footprints (for export)
buildings = [b[0] for b in buildings_out]

# 3D extruded volumes (for viewport)
def signed_area(pts):
    """Positive = CCW (normal points up), negative = CW (normal points down)."""
    n = len(pts) - 1
    return sum(pts[i].X * pts[i+1].Y - pts[i+1].X * pts[i].Y for i in range(n)) / 2

bldg_volumes = []
for _, h, pts in buildings_out:
    # Guarantee CCW winding so extrusion always goes upward
    if signed_area(pts) < 0:
        pts = list(reversed(pts))
    profile = rg.PolylineCurve(pts)
    vol = rg.Extrusion.Create(profile, h, True)
    if vol:
        bldg_volumes.append(vol)

# Lamp post sticks (vertical lines, 4m tall)
lamp_sticks = []
for pt in lamps_out:
    lamp_sticks.append(rg.LineCurve(pt, rg.Point3d(pt.X, pt.Y, 4)))

# ── 5. CSV Export ─────────────────────────────────────────────────────────────
if run_export and export_folder:
    try:
        with open(os.path.join(export_folder, 'synthetic_streets.csv'), 'w', newline='') as f:
            w = csv.writer(f)
            w.writerow(['segment_id', 'wkt_geometry', 'length_m'])
            for i, seg in enumerate(streets_out):
                w.writerow([i, crv_to_wkt(seg), round(seg.GetLength(), 3)])

        with open(os.path.join(export_folder, 'synthetic_buildings.csv'), 'w', newline='') as f:
            w = csv.writer(f)
            w.writerow(['building_id', 'wkt_geometry', 'height_m'])
            for i, (_, h, pts) in enumerate(buildings_out):
                w.writerow([i, poly_to_wkt(pts), h])

        with open(os.path.join(export_folder, 'synthetic_lamps.csv'), 'w', newline='') as f:
            w = csv.writer(f)
            w.writerow(['lamp_id', 'wkt_geometry'])
            for i, pt in enumerate(lamps_out):
                w.writerow([i, pt_to_wkt(pt)])

        msgs.append(f'Exported to: {export_folder}')
    except Exception as e:
        msgs.append(f'Export error: {e}')

log = '\n'.join(msgs)
# ---------- end python_3_script ----------
number = Number(expr("x/2", number_slider))
negative = Negative(Value=number)
brep = Brep(python_3_script.bldg_volumes)
curve = Curve(python_3_script.streets)
curve_2 = Curve(python_3_script.streets)
point = Point(python_3_script.lamps)
line = Line(python_3_script.lamp_sticks)
merge = Merge(Data1=number, Data2=negative)
offset_curve = OffsetCurve(Curve=graft(curve_2), Distance=merge, Corners=1)  # -> flatten(Curve)
unit_z = UnitZ(Factor=1)
move = Move(Geometry=offset_curve, Motion=unit_z)  # -> Geometry, Transform
brep_curve = BrepCurve(Brep=graft(brep), Curve=move.Geometry)  # -> Curves, Points
shift_paths = ShiftPaths(Data=brep_curve.Points, Offset=-1)
mass_addition = MassAddition(Input=shift_paths)  # -> Result, PartialResults
null_item = NullItem(Item=flatten(mass_addition.Result))  # -> NullFlags, InvalidFlags, Description
cull_pattern = CullPattern(List=brep, CullPattern=null_item.NullFlags)
